# Grasshopper definition Visualiser.gh (Grasshopper 1.0.7)

file = ReadFile(
    File="C:\Users\Chee Meng\OneDrive - National University of Singapore\Type0\Building a Timber House\Generative Layouts\MixedConstraintOptimisation\Mesh\output.txt",
    PerLineParse=True)
split = TextSplit(Text=file, Separators=" ")
cull_i = CullIndex(List=simplify(split), Indices=-1, Wrap=True)
pt = Point(cull_i)
shift = ShiftList(List=pt, Shift=-1, Wrap=True)
ln = Line(StartPoint=pt, EndPoint=shift)
